% Simulink data dictionary MyDict_2DOF.sldd

RollYStartThrust = Simulink.Parameter(40, StorageClass="Define")
RollYMotorSaturation = Simulink.Parameter(30, StorageClass="Define")
RollUpperLimit = Simulink.Parameter(0.4, StorageClass="Define")
RollLowerLimit = Simulink.Parameter(-0.33, StorageClass="Define")
PositionLoopSat = Simulink.Parameter(1, StorageClass="Define")
PitchXStartThrust = Simulink.Parameter(50, StorageClass="Define")
PitchXMotorSaturation = Simulink.Parameter(50, StorageClass="Define")
PitchUpperLimit = Simulink.Parameter(0.27, StorageClass="Define")
PitchLowerLimit = Simulink.Parameter(-0.37, StorageClass="Define")
mass_u = Simulink.Parameter(2.024, StorageClass="Define")
mass_l = Simulink.Parameter(2.495, StorageClass="Define")
L_u = Simulink.Parameter(0.227293, StorageClass="Define")
L_l = Simulink.Parameter(0.223793, StorageClass="Define")
L_cg_u = Simulink.Parameter(0.066301, StorageClass="Define")
L_cg_l = Simulink.Parameter(0.102366, StorageClass="Define")
JointY_InitialPositionCondition = Simulink.Parameter(-0.33, StorageClass="Define")
JointX_InitialPositionCondition = Simulink.Parameter(0.27, StorageClass="Define")
J_u = Simulink.Parameter(0.049103, StorageClass="Define")
J_l = Simulink.Parameter(0.071440709, StorageClass="Define")
iyvelkp = Simulink.Parameter(20, StorageClass="Define")
iyvelki = Simulink.Parameter(5, StorageClass="Define")
iyvelkd = Simulink.Parameter(0, StorageClass="Define")
iyposkp = Simulink.Parameter(10, StorageClass="Define")
iyposki = Simulink.Parameter(1, StorageClass="Define")
iyposkd = Simulink.Parameter(0, StorageClass="Define")
ixvelkd = Simulink.Parameter(0, StorageClass="Define")
ixposki = Simulink.Parameter(1, StorageClass="Define")
ixposkd = Simulink.Parameter(0, StorageClass="Define")
g = Simulink.Parameter(9.81, StorageClass="Define")
FilterCoeffN = Simulink.Parameter(10, StorageClass="Define")
B_u = Simulink.Parameter(0.5, StorageClass="Define")
B_l = Simulink.Parameter(0.5, StorageClass="Define")
ixvelkp = Simulink.Parameter(12, StorageClass="Define")
ixvelki = Simulink.Parameter(2, StorageClass="Define")
ixposkp = Simulink.Parameter(9.6, StorageClass="Define")